# Dynamo graph 09_DoorandWindowPlacement.dyn (Dynamo 2.6.1.8786)

code_block = CodeBlock { "DW_SET"; }
byName = Family.ByName(name=code_block)
types = Family.Types(family=byName)
all_elements_of_family_type = ElementsOfFamilyType(Family_Type=types)
flatten = List.Flatten(list=all_elements_of_family_type)
getLocation = Element.GetLocation(element=flatten)
categories = Categories("OST_Walls")
all_elements_of_category = ElementsOfCategory(Category=categories)
geometry = Element.Geometry(element=all_elements_of_category)
flatten_2 = List.Flatten(list=geometry)
python_script = Python(IN[0]=flatten, IN[1]=getLocation, IN[2]=flatten_2, IN[3]=all_elements_of_category)
# ---------- python_script.python (29 lines) ----------
# Load the Python Standard and DesignScript Libraries
import sys
import clr
clr.AddReference('ProtoGeometry')
from Autodesk.DesignScript.Geometry import *

# The inputs to this node will be stored as a list in the IN variables.
ELEM=IN[0]
POI=IN[1]
SOL=IN[2]
WALL=IN[3]
WA=[]
SEL=[]
POIS=[]
for c,d in zip(SOL,WALL):
	LN=[]
	LP=[]
	for a,b in zip(POI,ELEM):
		if Line.ByStartPointEndPoint(a,a.Translate(Vector.ByCoordinates(0,0,3))).DoesIntersect(c):
			LN.append(b)
			LP.append(a)
	if len(LN)>0:
		SEL.append(LN)			
		WA.append(d)
		POIS.append(LP)
# Place your code below this line

# Assign your output to the OUT variable.
OUT = WA,SEL,POIS
# ----------------------------------------
code_block_2 = CodeBlock(a=python_script) { a[0]; }
code_block_3 = CodeBlock(a=python_script) { a[1]; }
code_block_4 = CodeBlock { "Type"; }
getParameterValueByName = Element.GetParameterValueByName(element=code_block_3, parameterName=code_block_4)
code_block_5 = CodeBlock { "Family"; }
getParameterValueByName_2 = Element.GetParameterValueByName(element=getParameterValueByName, parameterName=code_block_5)
byName_2 = Family.ByName(name=getParameterValueByName_2)
code_block_6 = CodeBlock { "Type"; }
getParameterValueByName_3 = Element.GetParameterValueByName(element=getParameterValueByName, parameterName=code_block_6)
byFamilyAndName = FamilyType.ByFamilyAndName(family=byName_2, name=getParameterValueByName_3)
code_block_7 = CodeBlock(a=python_script) { a[2]; }
python_script_2 = Python(IN[0]=code_block_2, IN[1]=byFamilyAndName, IN[2]=code_block_7)
# ---------- python_script_2.python (41 lines) ----------
import clr
clr.AddReference("RevitServices")
import RevitServices
from RevitServices.Persistence import DocumentManager
from RevitServices.Transactions import TransactionManager
doc = DocumentManager.Instance.CurrentDBDocument

clr.AddReference("RevitAPI")
import Autodesk

clr.AddReference("RevitNodes")
import Revit
clr.ImportExtensions(Revit.Elements)
clr.ImportExtensions(Revit.GeometryConversion)

def tolist(obj1):
	if hasattr(obj1,"__iter__"): return obj1
	else: return [obj1]

host = UnwrapElement(tolist(IN[0]))
ftype = UnwrapElement(tolist(IN[1]))
fpts = UnwrapElement(tolist(IN[2]))

OUT = []
strt = Autodesk.Revit.DB.Structure.StructuralType.NonStructural
ftp_len = len(ftype) == 1
hst_len = len(host) == 1

TransactionManager.Instance.EnsureInTransaction(doc)
for i in xrange(len(fpts) ):
	p = fpts[i].ToXyz(True)
	j = 0 if ftp_len else i
	k = 0 if hst_len else i
	try:
		if not ftype[j].IsActive : ftype[j].Activate()
		level = doc.GetElement(host[k].LevelId)
		nf = doc.Create.NewFamilyInstance(p,ftype[j],host[k],level,strt)
		OUT.append(nf.ToDSType(False))
	except:
		OUT.append(None)
TransactionManager.Instance.TransactionTaskDone()
# ----------------------------------------
